# Grasshopper definition RGDUmbrellaPavilion.gh (Grasshopper 1.0.7)

openingr = GetInteger(Slider(20, range=0..50), AtLeast=1, AtMost=100, Maximum=2147483647, Minimum=-2147483648, TreeAccess=False)
openingh = GetInteger(Slider(10, range=0..50), AtLeast=1, AtMost=100, Maximum=2147483647, Minimum=-2147483648, TreeAccess=False)
topr = GetInteger(Slider(13, range=0..50), AtLeast=1, AtMost=100, Maximum=2147483647, Minimum=-2147483648, TreeAccess=False)
toph = GetInteger(Slider(13, range=0..20), AtLeast=1, AtMost=100, Maximum=2147483647, Minimum=-2147483648, TreeAccess=False)
baser = GetInteger(Slider(6, range=0..50), AtLeast=1, AtMost=100, Maximum=2147483647, Minimum=-2147483648, TreeAccess=False)
divideno = GetInteger(Slider(42, range=0..100), AtLeast=1, AtMost=100, Maximum=2147483647, Minimum=-2147483648, TreeAccess=False)
shiftbase = GetInteger(Slider(5, range=0..50), AtLeast=1, AtMost=100, Maximum=2147483647, Minimum=-2147483648, TreeAccess=False)
shifttop = GetInteger(Slider(5, range=0..50), AtLeast=1, AtMost=100, Maximum=2147483647, Minimum=-2147483648, TreeAccess=False)
shifttop1 = GetInteger(Slider(0, range=0..50), AtLeast=1, AtMost=100, Maximum=2147483647, Minimum=-2147483648, TreeAccess=False)

xy = XYPlane(Origin=Point(0, 0, 0))
xy_2 = XYPlane(Origin=Point(0, 0, 0))
xy_3 = XYPlane(Origin=Point(0, 0, 0))
cir = Circle(Plane=xy, Radius=openingr)
cir_2 = Circle(Plane=xy_2, Radius=topr)
cir_3 = Circle(Plane=xy_3, Radius=baser)
Z = UnitZ(Factor=openingh)
Z_2 = UnitZ(Factor=toph)
move = Move(Geometry=cir, Motion=Z)  # -> Geometry, Transform
move_2 = Move(Geometry=cir_2, Motion=Z_2)  # -> Geometry, Transform
divide = DivideCurve(Curve=[move.Geometry, move_2.Geometry, cir_3], Count=divideno, Kinks=False)  # -> Points, Tangents, Parameters
divide_2 = DivideCurve(Curve=[move.Geometry, move_2.Geometry, cir_3], Count=10, Kinks=False)  # -> Points, Tangents, Parameters
bang = ExplodeTree(Data=divide_2.Points)  # -> Branch0, Branch1, Branch2
bang_2 = ExplodeTree(Data=divide.Points)  # -> Branch0, Branch1, Branch2
arc = Arc3Pt(PointA=bang.Branch0, PointB=bang.Branch1, PointC=bang.Branch2)  # -> Arc, Plane, Radius
loft_opt = LoftOptions(Closed="true", Adjust=False, Rebuild=0, Refit=0, Type=0)
reb = RebuildCurve(Curve=arc.Arc, Count=10, Tangents=False)
loft = Loft(Curves=reb, Options=loft_opt)
shift = ShiftList(List=bang_2.Branch2, Shift=shiftbase, Wrap=True)
shift_2 = ShiftList(List=bang_2.Branch0, Shift=shifttop, Wrap=True)
shift_3 = ShiftList(List=bang_2.Branch0, Shift=shifttop1, Wrap=True)
geodesic = Geodesic(Surface=loft, Start=bang_2.Branch0, End=shift)
geodesic_2 = Geodesic(Surface=loft, Start=bang_2.Branch2, End=shift_2)
geodesic_3 = Geodesic(Surface=loft, Start=bang_2.Branch2, End=shift_3)
mcol = MeshColours(Mesh=loft, Colours=ColourSwatch(SwatchColor=RGB(73, 103, 227)))
pipe = Pipe(Curve=[move.Geometry, move_2.Geometry, cir_3], Radius="0.10", Caps=0)  # -> flatten(Pipe)
pipe_2 = Pipe(Curve=[geodesic_2, geodesic, geodesic_3], Radius="0.10", Caps=0)  # -> flatten(Pipe)
mcol_2 = MeshColours(Mesh=pipe_2, Colours=ColourSwatch(SwatchColor=RGB(0, 0, 0)))
mcol_3 = MeshColours(Mesh=pipe, Colours=ColourSwatch(SwatchColor=RGB(46, 46, 46)))
mjoin = MeshJoin(Meshes=flatten([mcol_3, mcol_2]))
context_bake = ContextBake(UmbrellaMesh=flatten(mcol))
context_bake_2 = ContextBake(UmbrellaSupport=flatten(mjoin))
panel = Panel("""MiddleCircleR
HeightOfMiddle
TopCircleR
HeightOfTop
BaseCircleR
DivisionCount
ShiftBase
ShiftMiddle
ShiftMiddle1""")
